# Dynamo graph test DataFrame extension MEPSYStem_git_v10.dyn (Dynamo 2.16.1.2727)

start_a_new_file = BoolSelector(false)
python_script_form = Python(IN[0]=start_a_new_file)  # CPython3
# ---------- python_script_form.python (95 lines) ----------
import clr
import sys
import System
clr.AddReference("System.Numerics")
#

clr.AddReference('System.Drawing')
clr.AddReference('System.Windows.Forms')
import System.Drawing
import System.Windows.Forms

from System.Drawing import *
from System.Windows.Forms import *

my_path = System.Environment.GetFolderPath(System.Environment.SpecialFolder.MyDocuments)
pf_path = System.Environment.GetFolderPath(System.Environment.SpecialFolder.ProgramFilesX86)

import time  


class MyForm(Form):
    #
    __namespace__ = f"MyForm_{int(time.time())}"
    def __init__(self):
        super().__init__()
        self.htmlDf = """\
        <html>
        <head>
        <meta http-equiv="X-UA-Compatible" content="IE=9">
        <style> 
          table, th, td {font-size:10pt; border:1px solid black; border-collapse:collapse; text-align:left;}
          th, td {padding: 5px;}
          tr:nth-child(even) {background: #E0E0E0;}
          tr:hover {background: silver; cursor: pointer;}
        </style>
        </head>
          <body>
          </body>
        </html>
        """
        self.InitializeComponent()
    
    def InitializeComponent(self):
        self._webBrowser1 = System.Windows.Forms.WebBrowser()
        self.SuspendLayout()
        # 
        # webBrowser1
        # 
        self._webBrowser1.Anchor = System.Windows.Forms.AnchorStyles.Top | System.Windows.Forms.AnchorStyles.Bottom | System.Windows.Forms.AnchorStyles.Left | System.Windows.Forms.AnchorStyles.Right
        self._webBrowser1.Dock = System.Windows.Forms.DockStyle.Fill
        self._webBrowser1.Location = System.Drawing.Point(0, 0)
        self._webBrowser1.ScriptErrorsSuppressed = True
        self._webBrowser1.Name = "webBrowser1"
        self._webBrowser1.Size = System.Drawing.Size(594, 528)
        self._webBrowser1.TabIndex = 0
        self._webBrowser1.DocumentText = self.htmlDf
        self._webBrowser1.DocumentCompleted += self.WebBrowser1DocumentCompleted
        # 
        # Form27
        # 
        self.ClientSize = System.Drawing.Size(600, 540)
        self.Controls.Add(self._webBrowser1)
        self.SizeGripStyle = System.Windows.Forms.SizeGripStyle.Show
        self.SizeChanged += self.FormSizeChanged
        self.Name = "Form27"
        self.Text = "PandasViewer"
        
    def WebBrowser1DocumentCompleted(self, sender, e):
        #self._webBrowser1.Size = self._webBrowser1.Document.Body.ScrollRectangle.Size
        self._webBrowser1.Document.Body.ScrollIntoView(False)
        
    def FormSizeChanged(self, sender, e):
        self._webBrowser1.Size = System.Drawing.Size.Subtract(self.ClientSize, System.Drawing.Size(10, 10))
        self._webBrowser1.Document.Body.Width = self.ClientSize.Width - 10
        
    #@property
    def get_HtmlText(self):
        #print(self.htmlDf)
        return self.htmlDf
        
    #@HtmlText.setter
    def set_HtmlText(self, value):
        self.htmlDf = value
        self._webBrowser1.Document.OpenNew(True)
        self._webBrowser1.Document.Write(self.htmlDf)
        self._webBrowser1.Refresh()
        
        #self.Activate()
    HtmlText = clr.clrproperty(str, get_HtmlText, set_HtmlText)


#if "viewerForm" not in dict(globals()): # get global variables
viewerForm = MyForm()
viewerForm.Show()
OUT = viewerForm
# ----------------------------------------
python_script_with_viewer = Python(IN[0]=python_script_form)  # CPython3
# ---------- python_script_with_viewer.python (130 lines) ----------
import clr
import sys
import System
clr.AddReference("System.Numerics")
#
clr.AddReference('ProtoGeometry')
from Autodesk.DesignScript.Geometry import *
import Autodesk.DesignScript.Geometry as DS

#import Revit API
clr.AddReference('RevitAPI')
import Autodesk
from Autodesk.Revit.DB import *
import Autodesk.Revit.DB as DB
#import specify namespace
from Autodesk.Revit.DB.Electrical import *
from Autodesk.Revit.DB.Structure import *

#import net library
from System import Array
from System.Collections.Generic import List, IList, Dictionary

#import transactionManager and DocumentManager (RevitServices is specific to Dynamo)
clr.AddReference('RevitServices')
import RevitServices
from RevitServices.Persistence import DocumentManager
from RevitServices.Transactions import TransactionManager

doc = DocumentManager.Instance.CurrentDBDocument

my_path = System.Environment.GetFolderPath(System.Environment.SpecialFolder.MyDocuments)
pf_path = System.Environment.GetFolderPath(System.Environment.SpecialFolder.ProgramFilesX86)


clr.AddReference('Python.Included')
import Python.Included as pyInc
path_py3_lib = pyInc.Installer.EmbeddedPythonHome
sys.path.append(path_py3_lib + r'\Lib\site-packages')
import numpy as np
import pandas as pd
import webbrowser
import matplotlib.pyplot as plt
import io
import base64
import re


@pd.api.extensions.register_dataframe_accessor("viewer")
class HtmlAccessor:
    def __init__(self, df_obj):
        self._obj = df_obj
    #
    def Show(self, n=0):
        """
        convert DataFrame to Html and show it 
        """
        # get current html
        htmlDf = viewerForm.htmlDf
        # convert current dataFrame to html
        if n == 0:
            html_toAdd = self._obj.to_html()
        else:
            html_toAdd = self._obj.head(n).to_html()
        # add to the current html
        htmlDf = re.sub(r"<\/body>", html_toAdd + r"<br><hr><br></body>", htmlDf)
        # update the html in form
        viewerForm.HtmlText = htmlDf

        
    def Plot(self, method="plot()"):
        """
        plot a DataFrame
        type = 'bar', 'area', 'box', 
        """
        plt.figure()
        s = io.BytesIO()
        if method.startswith("."):
            method = method[1:]
        if not method.startswith("plot"):
            method = "plot." + method
        #
        ax = eval("self._obj."+ method)
        #
        plt.savefig(s, format='png', bbox_inches="tight")
        plt.close()
        s = base64.b64encode(s.getvalue()).decode("utf-8").replace("\n", "")
        #
        htmlDf = viewerForm.htmlDf
        html_toAdd = """<img align="left" src="data:image/png;base64,{0}">""".format(s)   
        #
        # add to the current
        htmlDf = re.sub(r"<\/body>", html_toAdd + r"<br clear=left><hr><br></body>", htmlDf)
        #
        # update the html in form
        viewerForm.HtmlText = htmlDf

    
viewerForm = IN[0]

all_cable_tray = FilteredElementCollector(doc).OfCategory(BuiltInCategory.OST_CableTray).WhereElementIsNotElementType().ToElements()

df = pd.DataFrame({'DB_Element': all_cable_tray})
#
df['Name'] = df.apply(lambda x: x['DB_Element'].get_Name(), axis=1)
#
df['Service'] = df.apply(lambda x: x['DB_Element'].get_Parameter(BuiltInParameter.RBS_CTC_SERVICE_TYPE).AsValueString(), axis=1).astype(str)
#
df['Hauteur'] = df.apply(lambda x: x['DB_Element'].get_Parameter(BuiltInParameter.RBS_CABLETRAY_HEIGHT_PARAM).AsValueString(), axis=1).astype(str)
#
df['Largeur'] = df.apply(lambda x: x['DB_Element'].get_Parameter(BuiltInParameter.RBS_CABLETRAY_WIDTH_PARAM).AsValueString(), axis=1).astype(str)
#
df['Longueur'] = df.apply(lambda x: x['DB_Element'].get_Parameter(BuiltInParameter.CURVE_ELEM_LENGTH).AsValueString(), axis=1).apply(pd.to_numeric)


#
df.viewer.Show()

df.viewer.Show(5)
df.dtypes.to_frame().viewer.Show()
##
##
dfg = df.drop(['DB_Element'], axis=1)
dfg = dfg.groupby('Service')['Longueur'].sum()
dfg.to_frame().viewer.Show()
### 
dfg.to_frame().viewer.Plot()
dfg.to_frame().viewer.Plot("plot.bar(rot=0)")
df.viewer.Plot("box()")

OUT = df.__repr__ , df.dtypes
# ----------------------------------------
