# Dynamo graph Dynamo Challenge 03_3D_visualizer_v0.4.dyn (Dynamo 2.13.1.3887)

file_path = Filename("..\02_WAV files\music 01_BabyElephantWalk60.wav")

# group: Player
python_script = Python(IN[0]=file_path)  # IronPython2
# ---------- python_script.python (130 lines) ----------
# Charger les bibliothèques DesignScript et Standard Python
import sys
import clr
import System
temp_path = System.IO.Path.GetTempPath()

clr.AddReference('System.Drawing')
clr.AddReference('System.Windows.Forms')
import System.Drawing
import System.Windows.Forms

from System.Drawing import *
from System.Windows.Forms import *

import time

#reference loaded dynamo revit module
clr.AddReference('DynamoRevitDS')
import Dynamo 
clr.AddReference('DynamoCore')
from Dynamo.Graph import UpdateValueParams

#access to the current Dynamo instance and workspace
dynamoRevit = Dynamo.Applications.DynamoRevit()
engine = dynamoRevit.RevitDynamoModel.EngineController
currentWorkspace = dynamoRevit.RevitDynamoModel.CurrentWorkspace
model = dynamoRevit.RevitDynamoModel




class FormPlayer(Form):
    def __init__(self, wavfile, timestampNode):
        self._wavfile = wavfile
        self.fileName = System.IO.Path.GetFileName(wavfile)
        self._timestampNode = timestampNode
        self._player = System.Media.SoundPlayer(wavfile)
        self.InitializeComponent()
        self.UpdateTimeStampNode(reset = True)
    
    def InitializeComponent(self):
        self._label1 = System.Windows.Forms.Label()
        self._buttonCancel = System.Windows.Forms.Button()
        self._buttonPlay = System.Windows.Forms.Button()
        self.SuspendLayout()
        # 
        # label1
        # 
        self._label1.Anchor = System.Windows.Forms.AnchorStyles.Top | System.Windows.Forms.AnchorStyles.Left | System.Windows.Forms.AnchorStyles.Right
        self._label1.Font = System.Drawing.Font("Microsoft Sans Serif", 12, System.Drawing.FontStyle.Bold, System.Drawing.GraphicsUnit.Point, 0)
        self._label1.Location = System.Drawing.Point(100, 21)
        self._label1.Name = "label1"
        self._label1.Size = System.Drawing.Size(267, 48)
        self._label1.TabIndex = 0
        self._label1.Text = self.fileName
        self._label1.TextAlign = System.Drawing.ContentAlignment.MiddleCenter
        # 
        # buttonCancel
        # 
        self._buttonCancel.Anchor = System.Windows.Forms.AnchorStyles.Bottom | System.Windows.Forms.AnchorStyles.Left
        self._buttonCancel.Location = System.Drawing.Point(21, 91)
        self._buttonCancel.Name = "buttonCancel"
        self._buttonCancel.Size = System.Drawing.Size(110, 40)
        self._buttonCancel.TabIndex = 1
        self._buttonCancel.Text = "Stop"
        self._buttonCancel.UseVisualStyleBackColor = True
        self._buttonCancel.Click += self.ButtonCancelClick
        # 
        # buttonPlay
        # 
        self._buttonPlay.Anchor = System.Windows.Forms.AnchorStyles.Bottom | System.Windows.Forms.AnchorStyles.Right
        self._buttonPlay.Location = System.Drawing.Point(320, 91)
        self._buttonPlay.Name = "buttonPlay"
        self._buttonPlay.Size = System.Drawing.Size(110, 40)
        self._buttonPlay.TabIndex = 1
        self._buttonPlay.Text = "Play/ReStart"
        self._buttonPlay.UseVisualStyleBackColor = True
        self._buttonPlay.Click += self.ButtonPlayClick
        # 
        # Form16
        # 
        self.ClientSize = System.Drawing.Size(450, 156)
        self.MinimumSize = self.ClientSize + System.Drawing.Size(10, 10)
        self.Controls.Add(self._buttonPlay)
        self.Controls.Add(self._buttonCancel)
        self.Controls.Add(self._label1)
        self.Name = "Form16"
        self.Text = "FormPlayer"
        self.ResumeLayout(False)


    def ButtonCancelClick(self, sender, e):
        self._player.Stop()
        self.UpdateTimeStampNode(reset = True)
        time.sleep(0.1)
        self.Close()
        self.Dispose()
        
    def UpdateTimeStampNode(self, reset = False):
        if reset:
            ts = 0.0
        else:
            ts = time.time()
        params = UpdateValueParams("Value", str(ts))
        self._timestampNode.UpdateValue(params)

    def ButtonPlayClick(self, sender, e):
        ts = time.time()
        self.UpdateTimeStampNode()
        self._player.Play()


def get_decibel(target_time, freq):
    return spectrogram[int(freq * frequencies_index_ratio)][int(target_time * time_index_ratio)]
    
    
timestampNode = None

#find the specific node
for i in currentWorkspace.Nodes:
    if i.Name == "timespanNode":
        timestampNode = i
if timestampNode is not None:
    
    filenamePath = IN[0]
    fileName = System.IO.Path.GetFileName(filenamePath)
    copyfile_path = System.IO.Path.Combine(temp_path, fileName)
    System.IO.File.Copy(filenamePath, copyfile_path, True)
    player = FormPlayer(copyfile_path, timestampNode)
    player.Show()
# ----------------------------------------

# group: save start time play
timespanNode = DoubleInput(0)

# group: get Data form wav
python_script_2 = Python(IN[0]=file_path)  # CPython3
# ---------- python_script_2.python (60 lines) ----------
# Charger les bibliothèques DesignScript et Standard Python
import sys
import clr
import System
clr.AddReference('ProtoGeometry')
#from Autodesk.DesignScript.Geometry import *
import Autodesk.DesignScript.Geometry as DS

clr.AddReference('Python.Included')
import Python.Included as pyInc
path_py3_lib = pyInc.Installer.EmbeddedPythonHome
sys.path.append(path_py3_lib + r'\Lib\site-packages')


import numpy as np # 1.22 or less
#print(np.__version__)
import librosa
import ffmpeg 
import math

class AudioData:
    def __init__(self, fileName):
        # getting information from the file
        time_series, sample_rate = librosa.load(filename)
        # getting a matrix which contains amplitude values according to frequency and time indexes
        stft = np.abs(librosa.stft(time_series, hop_length=512, n_fft=2048*4))
        # converting the matrix to decibel matrix
        self.spectrogram = librosa.amplitude_to_db(stft, ref=np.max)
        self.frequencies = librosa.core.fft_frequencies(n_fft=2048*4)  # getting an array of frequencies
        # getting an array of time periodic
        times = librosa.core.frames_to_time(np.arange(self.spectrogram.shape[1]), sr=sample_rate, hop_length=512, n_fft=2048*4)
        self.time_index_ratio = len(times)/times[len(times) - 1]
        self.frequencies_index_ratio = len(self.frequencies) / self.frequencies[len(self.frequencies)-1]
        #
        self._analyserPoints = None
        
    @property
    def GraphScatterPoints(self):
        if self._analyserPoints is not None:
            return self._analyserPoints
        else:
            work_range = math.ceil(math.sqrt(len(self.frequencies) / 2))
            self._analyserPoints = []
            for i in range(work_range):
                for j in range(work_range):
                    p = DS.Point.ByCoordinates(i ,j , 1)
                    self._analyserPoints.append(p)
                    
            center = DS.Point.ByCoordinates(int(work_range / 2) , int(work_range / 2) , 1)
            self._analyserPoints.sort(key = lambda p : p.DistanceTo(center))
            return self._analyserPoints
            
    def Get_Decibel(self, target_time, freq):
        return self.spectrogram[int(freq * self.frequencies_index_ratio)][int(target_time * self.time_index_ratio)]
        
        
filename = IN[0]

obj = AudioData(filename)
OUT = obj
# ----------------------------------------

show_lines_instead_of_points = BoolSelector(false)
now = DateTime.Now()

# group: Music visualizer
python_script_3 = Python(IN[0]=python_script_2, IN[1]=show_lines_instead_of_points, IN[2]=now)  # CPython3
# ---------- python_script_3.python (66 lines) ----------
# Charger les bibliothèques DesignScript et Standard Python
import sys
import clr
import System
clr.AddReference('ProtoGeometry')
#from Autodesk.DesignScript.Geometry import *
import Autodesk.DesignScript.Geometry as DS

clr.AddReference('GeometryColor')
from Modifiers import GeometryColor
clr.AddReference('DSCoreNodes') 
import DSCore
from DSCore import Color as DSColor

clr.AddReference('DynamoRevitDS')
import Dynamo 
clr.AddReference('DynamoCore')
from Dynamo.Graph import UpdateValueParams
#access to the current Dynamo instance and workspace
dynamoRevit = Dynamo.Applications.DynamoRevit()
engine = dynamoRevit.RevitDynamoModel.EngineController
currentWorkspace = dynamoRevit.RevitDynamoModel.CurrentWorkspace
model = dynamoRevit.RevitDynamoModel

clr.AddReference('Python.Included')
import Python.Included as pyInc
path_py3_lib = pyInc.Installer.EmbeddedPythonHome
sys.path.append(path_py3_lib + r'\Lib\site-packages')


import numpy as np # 1.22 or less
import librosa
import ffmpeg 
import math
import time


obj_play = IN[0]
show_lines = IN[1]

timestampNode = None

#find the specific node
for i in currentWorkspace.Nodes:
    if i.Name == "timespanNode":
        timestampNode = i
outptdisplay = []
out_lvl_db = []
if timestampNode is not None:
    start_ts = timestampNode.GetValue(0,engine).Data
    if start_ts > 0.0:
        current_timePlay = time.time() - start_ts
        for pt, fg in zip(obj_play.GraphScatterPoints, obj_play.frequencies):
            basept = DS.Point.ByCoordinates(pt.X ,pt.Y , -21.1)
            #fg = np.random.choice(obj_play.frequencies)
            lvldb =  obj_play.Get_Decibel(current_timePlay, fg)
            newpt = DS.Point.ByCoordinates(pt.X ,pt.Y , lvldb * 0.25)
            out_lvl_db.append(newpt.Z)
            if show_lines:
                line = DS.Line.ByStartPointEndPoint(basept, newpt)
                outptdisplay.append(line)
                basept.Dispose()
            else:
                outptdisplay.append(newpt)

OUT = outptdisplay, out_lvl_db
# ----------------------------------------
code_block = CodeBlock(x=python_script_3) { lst_geo = x[0]; lvldb = x[1]; }
remapRange = Math.RemapRange(numbers=code_block.lvldb)
color_range = ColorRange(value=remapRange)  # unwired: colors, indices
byGeometryColor = Modifiers.GeometryColor.ByGeometryColor(geometry=code_block.lst_geo, color=color_range)
