# Dynamo graph mandelbrot zoom_DYN3_v6.dyn (Dynamo 3.0.3.7597)

now = DateTime.Now()
use_set_pixel = BoolSelector(true)
python_script_main = Python(IN[0]=now, IN[1]=use_set_pixel)  # IronPython3
# ---------- python_script_main.python (146 lines) ----------
#import time
#t1 = time.time()
#import sys
import clr
import System
from System.Runtime.InteropServices import Marshal

clr.AddReference("System.Core")
clr.ImportExtensions(System.Linq)

clr.AddReference('DynamoRevitDS')
import Dynamo 
#reference dynamo core to update node values
clr.AddReference('DynamoCore')
from Dynamo.Graph import UpdateValueParams

#access to the current Dynamo instance and workspace
dynamoRevit = Dynamo.Applications.DynamoRevit()
engine = dynamoRevit.RevitDynamoModel.EngineController
currentWorkspace = dynamoRevit.RevitDynamoModel.CurrentWorkspace
model = dynamoRevit.RevitDynamoModel

clr.AddReference('System.Drawing')
from System.Drawing import Color, Bitmap, Imaging, Rectangle, Image

import colorsys
import math
#import time

px, py = -0.7746806106269039, -0.1374168856037867 #Tante Renate
R = 3 
max_iteration = 170 #2500
w, h = 400, 400 #1024,1024
mfactor = 0.5



def Mandelbrot2(*args):
    """
    get Mandelbrot fractal 
    """
    x, y, max_iteration, minx, maxx, miny, maxy = args
    zx = 0
    zy = 0
    RX1, RX2, RY1, RY2 = px-R/2.0, px+R/2.0, py-R/2.0, py+R/2.0
    cx = (x-minx)/float(maxx-minx)*(RX2-RX1)+RX1
    cy = (y-miny)/float(maxy-miny)*(RY2-RY1)+RY1
    i=0
    while zx**2 + zy**2 <= 4 and i < max_iteration:
        temp = zx**2 - zy**2
        zy = 2*zx*zy + cy
        zx = temp + cx
        i += 1
    return x, y, i
    
def image_by_lockBits(data_array):
    global w
    global h
    global max_iteration
    global mfactor
    bmpOut = Bitmap(w, h, Imaging.PixelFormat.Format24bppRgb)
    newData = bmpOut.LockBits(
                            Rectangle(0, 0, w, h),
                            Imaging.ImageLockMode.WriteOnly, bmpOut.PixelFormat)
    newBytesPerPixel = int(Image.GetPixelFormatSize(bmpOut.PixelFormat) / 8)
    for x, y, c in data_array:
        v = c**mfactor/float(max_iteration**mfactor)
        hv = 0.67-v
        if hv<0: 
            hv+=1
        r,g,b = colorsys.hsv_to_rgb(hv,1,1-(v-0.1)**2/0.9**2)
        r = min(255,round(r*255))
        g = min(255,round(g*255))
        b = min(255,round(b*255))
        
        newPixelIndex = y * newData.Stride + x * newBytesPerPixel
        Marshal.WriteByte(newData.Scan0, newPixelIndex, r)
        Marshal.WriteByte(newData.Scan0, newPixelIndex + 1, g)
        Marshal.WriteByte(newData.Scan0, newPixelIndex + 2, b)
    bmpOut.UnlockBits(newData)
    #
    return bmpOut
 
def image_by_setPixel(data_array):
    global w
    global h
    global max_iteration
    global mfactor
    #
    bmpOut = Bitmap(w, h)
    # color pixels
    for x, y, c in data_array:
        v = c**mfactor/float(max_iteration**mfactor)
        hv = 0.67-v
        if hv<0: 
            hv+=1
        r,g,b = colorsys.hsv_to_rgb(hv,1,1-(v-0.1)**2/0.9**2)
        r = min(255,round(r*255))
        g = min(255,round(g*255))
        b = min(255,round(b*255))
        bmpOut.SetPixel(x, y, Color.FromArgb(r, g, b))
    #
    return bmpOut

def gen_Mandelbrot_image(sequence, useSetPixel=False):
    global w
    global h
    byteArr = []
    ziplst = []
    for x in range(w):
        for y in range(h):
            ziplst.append([x, y, max_iteration, 0, w-1, 0, h-1])
            
    # apply multiprocessing parrlalelisme
    threadResult = ziplst.AsParallel()\
        .WithDegreeOfParallelism(System.Environment.ProcessorCount)\
        .WithExecutionMode(System.Linq.ParallelExecutionMode.ForceParallelism)\
        .Select(lambda e : Mandelbrot2(*e))
    #
    if useSetPixel:
        return image_by_setPixel(threadResult)
    else:
        return image_by_lockBits(threadResult)

nodeK = next((i for i in currentWorkspace.Nodes if i.Name.Equals("K_R")), None)
if nodeK is not None:
    # get values
    k = int(nodeK.GetValue(0,engine).Data) 
    R = float(nodeK.GetValue(1,engine).Data) 

f = 0.80
RZF = 1/1000000000000
useSetPixel = IN[1]

if k < 40 :
    mfactor = 0.5 + (1/float(1000000000000))**0.1/float(R**0.1)
    #print(k,mfactor)
    #t1 = time.time()
    imgM = gen_Mandelbrot_image(k, useSetPixel)
    #print("elasped {}s".format(time.time() - t1))
    R *= f
    k+=1
    params = UpdateValueParams("Code", "{0};\n{1};".format(k, R))
    nodeK.UpdateValue(params)

    OUT = imgM
# ----------------------------------------
watch_image = WatchImageCore(image=python_script_main)

# group: init values (1,2)
# set values at start :
# 1
# 2
K_R = CodeBlock { 1; 2; }
