# Dynamo graph terrasac_geom_DYN3_v0.4.dyn (Dynamo 3.0.3.7597)

now = DateTime.Now()
python_script = Python(IN[0]=now)  # CPython3
# ---------- python_script.python (99 lines) ----------
import clr
import System
clr.AddReference('ProtoGeometry')
from Autodesk.DesignScript.Geometry import *
import math

clr.AddReference('DSCoreNodes')
from DSCore import Color as DSColor 
clr.AddReference('GeometryColor')
from Modifiers import GeometryColor


clr.AddReference('DynamoRevitDS')
import Dynamo 
clr.AddReference('DynamoCore')
from Dynamo.Graph import UpdateValueParams
#access to the current Dynamo instance and workspace
dynamoRevit = Dynamo.Applications.DynamoRevit()
engine = dynamoRevit.RevitDynamoModel.EngineController
currentWorkspace = dynamoRevit.RevitDynamoModel.CurrentWorkspace
model = dynamoRevit.RevitDynamoModel
net_clr_runtime_name = ".Net Runtime : " + str(System.Environment.Version)

# Define the function for matrix multiplication (matrix by vector)
def matrix_multiply(mat, vec):
    return [
        sum(mat[i][j] * vec[j] for j in range(len(vec)))
        for i in range(len(mat))
    ]

# Project 4D coordinates to 3D
def project_4d_to_3d(point, scale, center):
    w = 1.0 / (4 - point[3])  # Perspective projection
    return [scale * w * point[i] + center[i] for i in range(3)]

# Define a function to create lines between points
def create_lines(points, connections_colors):
    lines = []
    for start, end, ds_color in connections_colors:
        line = Line.ByStartPointEndPoint(points[start], points[end])
        objColor = GeometryColor.ByGeometryColor(line, ds_color)
        lines.append(objColor)
    return lines

# Define the tesseract's vertices in 4D
points_4d = [
    [-1, -1, -1, 1], [1, -1, -1, 1], [1, 1, -1, 1], [-1, 1, -1, 1],
    [-1, -1, 1, 1], [1, -1, 1, 1], [1, 1, 1, 1], [-1, 1, 1, 1],
    [-1, -1, -1, -1], [1, -1, -1, -1], [1, 1, -1, -1], [-1, 1, -1, -1],
    [-1, -1, 1, -1], [1, -1, 1, -1], [1, 1, 1, -1], [-1, 1, 1, -1]
]

# Define rotation angles and setup rotation matrices for 4D rotation
#find the specific node
nodeK = next((i for i in currentWorkspace.Nodes if i.Name =="angle"), None)
if nodeK is not None:
    # get values
    d = nodeK.GetValue(0,engine)
    angle = float(nodeK.GetValue(0,engine).Data) 

cos_a, sin_a = math.cos(angle), math.sin(angle)
rotation_xy = [[cos_a, -sin_a, 0, 0], [sin_a, cos_a, 0, 0], [0, 0, 1, 0], [0, 0, 0, 1]]
rotation_zw = [[1, 0, 0, 0], [0, 1, 0, 0], [0, 0, cos_a, -sin_a], [0, 0, sin_a, cos_a]]

# Apply rotations
points_4d_rotated = [matrix_multiply(rotation_xy, p) for p in points_4d]
points_4d_rotated = [matrix_multiply(rotation_zw, p) for p in points_4d_rotated]

# Project points to 3D
scale = 200  # Scale factor for visualization
center = [400, 400, 0]  # Center of the tesseract projection
points_3d = [Point.ByCoordinates(*project_4d_to_3d(p, scale, center)) for p in points_4d_rotated]

# Define connections based on the tesseract's edges
ds_colorA = DSColor.ByARGB(255, 255,0,0)
ds_colorB = DSColor.ByARGB(255, 46, 134, 193)
ds_colorC = DSColor.ByARGB(255, 0,0,0)
connections_colors = [
    # first cube
    (0, 1, ds_colorA), (1, 2, ds_colorA), (2, 3, ds_colorA), (3, 0, ds_colorA),
    (4, 5, ds_colorA), (5, 6, ds_colorA), (6, 7, ds_colorA), (7, 4, ds_colorA),
    (0, 4, ds_colorA), (1, 5, ds_colorA), (2, 6, ds_colorA), (3, 7, ds_colorA),
    # second cube
    (8, 9, ds_colorB), (9, 10, ds_colorB), (10, 11, ds_colorB), (11, 8, ds_colorB),
    (12, 13, ds_colorB), (13, 14, ds_colorB), (14, 15, ds_colorB), (15, 12, ds_colorB),
    (8, 12, ds_colorB), (9, 13, ds_colorB), (10, 14, ds_colorB), (11, 15, ds_colorB),
    # sommets
    (0, 8, ds_colorC), (1, 9, ds_colorC), (2, 10, ds_colorC), (3, 11, ds_colorC),
    (4, 12, ds_colorC), (5, 13, ds_colorC), (6, 14, ds_colorC), (7, 15, ds_colorC)
]

# Create lines between connected points
lines = create_lines(points_3d, connections_colors)

# Output the lines to Dynamo to visualize the tesseract
OUT = net_clr_runtime_name, lines, points_3d

params = UpdateValueParams("Code", "{0};".format(angle + 0.01))
nodeK.UpdateValue(params)
# ----------------------------------------

# group: angle (init 0)
angle = CodeBlock { 0; }
