# Dynamo graph Speech.Recognition_DynamoBim_V5.dyn (Dynamo 2.8.0.2471)

# group: voice Command _v2
now = DateTime.Now()
python_script = Python(IN[0]=now)  # IronPython2; frozen
# ---------- python_script.python (83 lines) ----------
# coding: utf-8
import sys
import clr
import System 

#import Revit API
clr.AddReference('RevitAPI')
import Autodesk
from Autodesk.Revit.DB import *

clr.AddReference('RevitAPIUI')
from Autodesk.Revit.UI import *

clr.AddReference('RevitServices')
import RevitServices
from RevitServices.Persistence import DocumentManager
from RevitServices.Transactions import TransactionManager

doc = DocumentManager.Instance.CurrentDBDocument
uiapp = DocumentManager.Instance.CurrentUIApplication

clr.AddReference("System.Windows.Forms")
import System.Windows.Forms
from System.Windows.Forms import * 
from System import Array 

clr.AddReference("System.Speech, Version=3.0.0.0, Culture=neutral, PublicKeyToken=31bf3856ad364e35")
from System.Speech.Recognition import (SpeechRecognitionEngine, GrammarBuilder, Grammar, Choices, RecognizeMode)
from System.Threading import Thread, ThreadStart
from System.Speech.Synthesis import SpeechSynthesizer
	

class ModExtEvent(IExternalEventHandler):
	def __init__(self, comandePostable):
		self._comandePostable = comandePostable
		self.name = comandePostable.ToString()

	def Execute(self, _uiap):
		_uiap.PostCommand(RevitCommandId.LookupPostableCommandId(self._comandePostable)) 
		
	def GetName(self):
		return self.name	


class EventUtils(ModExtEvent):
	def __init__(self, comandePostable):
		ModExtEvent.__init__(self, comandePostable)
		self.ext_event = ExternalEvent.Create(self)
		

def main(*args):
	global lstComandName
	lstName = Array[System.String]([x.name for x in args])
	lstComandName = lstName[:]
	#
	sre = SpeechRecognitionEngine()
	sre.SetInputToDefaultAudioDevice()
	sre.UnloadAllGrammars()
	#
	gb = GrammarBuilder()
	gb.Append(Choices(lstName))
	sre.LoadGrammar(Grammar(gb))
	#init Voice Synthesizer
	spk = SpeechSynthesizer()
	
	def OnSpeechRecognized(sender, e):	
		spk.Speak(e.Result.Text + "Command Processing")
		for objEvent in args:
			if e.Result.Text == objEvent.name:
				objEvent.ext_event.Raise()	
					
	
	sre.SpeechRecognized += OnSpeechRecognized
	sre.RecognizeAsync(RecognizeMode.Multiple)
if False:
	lstComandName = []
	obj_handlerMi = EventUtils(PostableCommand.MirrorProject)
	obj_handlerSpace = EventUtils(PostableCommand.Space)
	obj_handlerModLine = EventUtils(PostableCommand.ModelLine)
	main(obj_handlerMi, obj_handlerSpace, obj_handlerModLine)
	
			
	OUT = lstComandName
# ----------------------------------------
list_voices_command = Watch(python_script)

boolean = BoolSelector(true)

# group: with a main Thread and message Box
python_script_2 = Python(IN[0]=boolean)  # IronPython2; frozen
# ---------- python_script_2.python (113 lines) ----------
# -*- coding: utf-8 -*-
import sys
import clr
import System 
import time
clr.AddReference('ProtoGeometry')
from Autodesk.DesignScript.Geometry import *

#import Revit API
clr.AddReference('RevitAPI')
import Autodesk
from Autodesk.Revit.DB import *

clr.AddReference('RevitAPIUI')
from Autodesk.Revit.UI import *


clr.AddReference('RevitServices')
import RevitServices
from RevitServices.Persistence import DocumentManager
from RevitServices.Transactions import TransactionManager

doc = DocumentManager.Instance.CurrentDBDocument
uiapp = DocumentManager.Instance.CurrentUIApplication

clr.AddReference("System.Windows.Forms")
import System.Windows.Forms
from System.Windows.Forms import * 
from System import Array 

clr.AddReference("System.Speech, Version=3.0.0.0, Culture=neutral, PublicKeyToken=31bf3856ad364e35")
from System.Speech.Recognition import (SpeechRecognitionEngine, GrammarBuilder, Grammar, Choices, RecognizeMode)
from System.Threading import Thread, ThreadStart
from System.Speech.Synthesis import SpeechSynthesizer


	

class ModExtEvent(IExternalEventHandler):
	def __init__(self, comandePostable):
		self._comandePostable = comandePostable
		self.name = comandePostable.ToString()

	def Execute(self, _uiap):
		_uiap.PostCommand(RevitCommandId.LookupPostableCommandId(self._comandePostable)) 
		
	def GetName(self):
		return self.name	


class EventUtils(ModExtEvent):
	def __init__(self, comandePostable):
		ModExtEvent.__init__(self, comandePostable)
		self.ext_event = ExternalEvent.Create(self)
		

def main(*args):
	global lstComandName
	lstName = Array[System.String]( [x.name for x in args] + ["quit"])
	lstComandName = lstName[:]
	#MessageBox.Show('_'.join([x.name for x in args]))
	#MessageBox.Show("SpeechRecognition Start \n\n-" + '\n-'.join([x for x in lstName]))
	sre = SpeechRecognitionEngine()
	sre.SetInputToDefaultAudioDevice()
	sre.UnloadAllGrammars()

	gb = GrammarBuilder()
	gb.Append(Choices(lstName))
	sre.LoadGrammar(Grammar(gb))
	
	spk = SpeechSynthesizer()
	#spk.Speak('Hello world!')
	
	def OnSpeechRecognized(sender, e):
		#MessageBox.Show(e.Result.Text)
		spk.Speak(e.Result.Text + "Command Processing")
		if "quit" in e.Result.Text :
			#pass
			Thread.CurrentThread.Join()
			Thread.CurrentThread.Abort()	
		else:	
			for objEvent in args:
				if e.Result.Text == objEvent.name:
					objEvent.ext_event.Raise()	
					

		
	sre.SpeechRecognized += OnSpeechRecognized

	sre.RecognizeAsync(RecognizeMode.Multiple)


lstComandName = []

if False:	
	#event for Mirror
	#obj_handlerMi = ModExtEvent(PostableCommand.MirrorProject)
	#ext_eventMi = ExternalEvent.Create(obj_handlerMi)
	#event for Tag
	#obj_handlerSpace = ModExtEvent(PostableCommand.Space)
	#ext_eventSpace = ExternalEvent.Create(obj_handlerSpace)
	#main(ext_eventMi, ext_eventSpace)

	obj_handlerMi = EventUtils(PostableCommand.MirrorProject)
	obj_handlerSpace = EventUtils(PostableCommand.Space)
	obj_handlerModLine = EventUtils(PostableCommand.ModelLine)
	#main(obj_handlerMi, obj_handlerSpace)
	thread = Thread(ThreadStart(lambda : main(obj_handlerMi, obj_handlerSpace, obj_handlerModLine)))
	thread.Start()
	time.sleep(2)
	
		
	OUT = lstComandName 
# ----------------------------------------

list_voices_command_2 = Watch(python_script_2)

# group: with winform v1
boolean_2 = BoolSelector(true)  # frozen
python_script_3 = Python(IN[0]=boolean_2)  # IronPython2
# ---------- python_script_3.python (151 lines) ----------
# -*- coding: utf-8 -*-
import sys
import clr
import System 
import time
clr.AddReference('ProtoGeometry')
from Autodesk.DesignScript.Geometry import *

#import Revit API
clr.AddReference('RevitAPI')
import Autodesk
from Autodesk.Revit.DB import *

clr.AddReference('RevitAPIUI')
from Autodesk.Revit.UI import *


clr.AddReference('RevitServices')
import RevitServices
from RevitServices.Persistence import DocumentManager
from RevitServices.Transactions import TransactionManager

doc = DocumentManager.Instance.CurrentDBDocument
uiapp = DocumentManager.Instance.CurrentUIApplication

clr.AddReference("System.Drawing")
clr.AddReference("System.Windows.Forms")
import System.Drawing
import System.Windows.Forms

from System.Drawing import *
from System.Windows.Forms import *

from System import Array 

clr.AddReference("System.Speech, Version=3.0.0.0, Culture=neutral, PublicKeyToken=31bf3856ad364e35")
from System.Speech.Recognition import (SpeechRecognitionEngine, GrammarBuilder, Grammar, Choices, RecognizeMode)
from System.Threading import Thread, ThreadStart
from System.Speech.Synthesis import SpeechSynthesizer


	

class ModExtEvent(IExternalEventHandler):
	def __init__(self, comandePostable):
		self._comandePostable = comandePostable
		self.name = comandePostable.ToString()

	def Execute(self, _uiap):
		_uiap.PostCommand(RevitCommandId.LookupPostableCommandId(self._comandePostable)) 
		
	def GetName(self):
		return self.name	


class EventUtils(ModExtEvent):
	def __init__(self, comandePostable):
		ModExtEvent.__init__(self, comandePostable)
		self.ext_event = ExternalEvent.Create(self)
		
		
		
		
class Form1(Form):
	def __init__(self, *args):
		lstName = Array[System.String]( [x.name for x in args] + ["quit"])
		self.lstComandName = lstName[:]
		self.args = args

		self.sre = SpeechRecognitionEngine()
		self.sre.SetInputToDefaultAudioDevice()
		self.sre.UnloadAllGrammars()
	
		gb = GrammarBuilder()
		gb.Append(Choices(lstName))
		self.sre.LoadGrammar(Grammar(gb))
		
		self.spk = SpeechSynthesizer()
		self.InitializeComponent()
	
	def InitializeComponent(self):

		self._buttonStart = System.Windows.Forms.Button()
		self._buttonStop = System.Windows.Forms.Button()
		self.SuspendLayout()
		# 
		# buttonStart
		# 
		self._buttonStart.Location = System.Drawing.Point(54, 34)
		self._buttonStart.Name = "buttonStart"
		self._buttonStart.Size = System.Drawing.Size(178, 50)
		self._buttonStart.TabIndex = 0
		self._buttonStart.Text = "Start"
		self._buttonStart.UseVisualStyleBackColor = True
		self._buttonStart.Click += self.ButtonStartClick
		# 
		# buttonStop
		# 
		self._buttonStop.Location = System.Drawing.Point(54, 99)
		self._buttonStop.Name = "buttonStop"
		self._buttonStop.Size = System.Drawing.Size(178, 50)
		self._buttonStop.TabIndex = 0
		self._buttonStop.Text = "Stop"
		self._buttonStop.UseVisualStyleBackColor = True
		self._buttonStop.Click += self.ButtonStopClick
		# 
		# Form1
		# 
		self.ClientSize = System.Drawing.Size(284, 186)
		self.Controls.Add(self._buttonStop)
		self.Controls.Add(self._buttonStart)
		self.Name = "Form1"
		self.Text = "Form1"
		self.ResumeLayout(False)


	def ButtonStartClick(self, sender, e):
		self.thread = Thread(ThreadStart(self.StartRecognition))
		self.thread.Start()

	def ButtonStopClick(self, sender, e):
		self.thread.Join()
		self.thread.Abort()
		self.Close()	

	def StartRecognition(self):
		self.sre.SpeechRecognized += self.OnSpeechRecognized
		self.sre.RecognizeAsync(RecognizeMode.Multiple)

	def OnSpeechRecognized(self, sender, e):
		MessageBox.Show(e.Result.Text)
		"""
		self.spk.Speak(e.Result.Text + "Command Processing")
		if "quit" in e.Result.Text :
			pass
			#Thread.CurrentThread.Join()
			#Thread.CurrentThread.Abort()	
		else:	
			for objEvent in self.args:
				if e.Result.Text == objEvent.name:
					objEvent.ext_event.Raise()			
		"""
if False:
	obj_handlerMi = EventUtils(PostableCommand.MirrorProject)
	obj_handlerSpace = EventUtils(PostableCommand.Space)
	obj_handlerModLine = EventUtils(PostableCommand.ModelLine)
	
	objForm = Form1(obj_handlerMi, obj_handlerSpace, obj_handlerModLine)	
	objForm.Show()
			
	OUT = objForm.lstComandName 
# ----------------------------------------

list_postablecommand_enumeration = CodeBlock()  # "List PostableCommand Enumeration (Revit API)"
# ---------- list_postablecommand_enumeration.designscript (20 lines) ----------
["ElectricalFixture",
"ElectricalEquipment",
"LightingFixture",
"FireAlarm",
"Lighting",
"Security",
"Data",
"NurseCall",
"MirrorProject",
"Space",
"SpotCoordinate",
"VisibilityOrGraphics",
"CloseInactiveViews",
"CloseHiddenWindows",
"AlignedDimension",
"LinearDimension",
"SystemBrowser",
"Camera",
"Align",
"BrowserOrganization"];
# ----------------------------------------
python_script_4 = Python(IN[0]=list_postablecommand_enumeration)  # IronPython2
# ---------- python_script_4.python (128 lines) ----------
#coding: utf-8
#written by Cyril POUPIN
#v5
import sys
import clr
import System 

clr.AddReference('RevitAPI')
import Autodesk
from Autodesk.Revit.DB import *

clr.AddReference('RevitAPIUI')
from Autodesk.Revit.UI import *

clr.AddReference("System.Drawing")
clr.AddReference("System.Windows.Forms")
import System.Drawing
import System.Windows.Forms

from System.Drawing import *
from System.Windows.Forms import *
from System import Array 

clr.AddReference("System.Speech, Version=3.0.0.0, Culture=neutral, PublicKeyToken=31bf3856ad364e35")
from System.Speech.Recognition import (SpeechRecognitionEngine, GrammarBuilder, Grammar, Choices, RecognizeMode)
from System.Speech.Synthesis import SpeechSynthesizer, VoiceGender, VoiceAge


class ModExtEvent(IExternalEventHandler):
	def __init__(self, comandePostable):
		self._comandePostable = comandePostable
		self.name = comandePostable.ToString()

	def Execute(self, _uiap):
		_uiap.PostCommand(RevitCommandId.LookupPostableCommandId(self._comandePostable)) 
		
	def GetName(self):
		return self.name	

class EventUtils(ModExtEvent):
	def __init__(self, comandePostable):
		ModExtEvent.__init__(self, comandePostable)
		self.ext_event = ExternalEvent.Create(self)
		
			
class Form1(Form):
	def __init__(self, lstObj_handler):
		lstName = Array[System.String]( [x.name for x in lstObj_handler])
		self.lstComandName = lstName[:]
		self._lstObj_handler = lstObj_handler
		greatBritainCulture = System.Globalization.CultureInfo("en-GB")
		self.sre = SpeechRecognitionEngine()
		self.sre.SetInputToDefaultAudioDevice()
		self.sre.UnloadAllGrammars()
		gb = GrammarBuilder()
		gb.Append(Choices(lstName))
		self.sre.LoadGrammar(Grammar(gb))
		self.sre.MaxAlternates = 1
		
		self.spk = SpeechSynthesizer()
		self.spk .SelectVoiceByHints(VoiceGender.Female, VoiceAge.Senior, 0, greatBritainCulture)
		self.InitializeComponent()
	
	def InitializeComponent(self):
		self.spk.Speak("Start Speech Recognition Engine")
		self._buttonStop = System.Windows.Forms.Button()
		self._listBox1 = System.Windows.Forms.ListBox()
		self._label1 = System.Windows.Forms.Label()
		self.SuspendLayout()
		self.sre.SpeechRecognized += self.OnSpeechRecognized
		self.sre.RecognizeAsync(RecognizeMode.Multiple)
		# 
		# buttonStop
		self._buttonStop.Location = System.Drawing.Point(51, 190)
		self._buttonStop.Name = "buttonStop"
		self._buttonStop.Size = System.Drawing.Size(178, 50)
		self._buttonStop.TabIndex = 0
		self._buttonStop.Text = "Stop Engine"
		self._buttonStop.UseVisualStyleBackColor = True
		self._buttonStop.Click += self.ButtonStopClick
		# 
		# listBox1
		self._listBox1.FormattingEnabled = True
		self._listBox1.Items.AddRange(System.Array[System.Object](self.lstComandName))
		self._listBox1.Location = System.Drawing.Point(51, 34)
		self._listBox1.Name = "listBox1"
		self._listBox1.Size = System.Drawing.Size(178, 134)
		self._listBox1.TabIndex = 1
		# 
		# label1
		self._label1.Location = System.Drawing.Point(51, 5)
		self._label1.Name = "label1"
		self._label1.Size = System.Drawing.Size(178, 23)
		self._label1.TabIndex = 2
		self._label1.Text = "List Voice Commands available"
		# 
		# Form1
		self.ClientSize = System.Drawing.Size(284, 252)
		self.Controls.Add(self._label1)
		self.Controls.Add(self._listBox1)
		self.Controls.Add(self._buttonStop)
		self.Name = "SpeechRecognition"
		self.Text = "Speech Recognition"
		self.ResumeLayout(False)

	def ButtonStopClick(self, sender, e):
		self.spk.Speak("Stop Speech Recognition Engine, see you soon!")
		for objEvent in self._lstObj_handler:
			objEvent.ext_event.Dispose()	
		self.sre.Dispose()
		self.spk.Dispose()
		self.Close()	

	def OnSpeechRecognized(self, sender, e):
		self.sre.RecognizeAsyncStop()
		self.spk.Speak(e.Result.Text + "Command Processing")
		for objEvent in self._lstObj_handler:
			if e.Result.Text == objEvent.name:
				objEvent.ext_event.Raise()		
		self.sre.RecognizeAsync(RecognizeMode.Multiple)				

lstEnumsPCmd = System.Enum.GetNames(PostableCommand)
lstObj_handler = [EventUtils(eval("PostableCommand." + nameCommand)) for nameCommand in IN[0] if nameCommand in lstEnumsPCmd ]

objForm = Form1(lstObj_handler)	
objForm.Show()
		
OUT = objForm.lstComandName, lstEnumsPCmd
# ----------------------------------------
