# Dynamo graph Test DynamoTensorflow_v4.dyn (Dynamo 2.10.0.3455)
# packages: spring nodes 204.1.0

# group: Points for train Learning
code_block = CodeBlock { 0.1..9..#12; }
code_block_2 = CodeBlock(n=code_block)
# ---------- code_block_2.designscript (9 lines) ----------
nbrPoint = 200;
//randomPts = Point.ByCoordinates(Math.RandomList(nbrPoint, -0.1, 1, 1) * 10, Math.RandomList(nbrPoint) * 10, 0);
randomPts = List.Shuffle(List.Flatten(Point.ByCoordinates(n<0> , n<1> , 0)));
radius = 2.7;
pt = Point.ByCoordinates(4.7,4.7,0);
c = Circle.ByCenterPointRadius(pt, radius);
//Boolean list Test if each random point is inside circle
boolList = randomPts.DistanceTo(pt) < radius;
randomPts.DistanceTo(pt);
# ----------------------------------------

# group: for trainning Model
watch_points = Watch(code_block_2.randomPts)
watch_is_inside_circle_bool = Watch(code_block_2.boolList)

# group: Spheres
code_block_3 = CodeBlock { 1..6.0..#3; 1..5.0..#2; 2.5..5.8..#3; }
code_block_4 = CodeBlock(n=code_block_3.out2) { pts = Point.ByCoordinates(n<0>, n<1>, 0); flatPts = List.Flatten(pts); sph = Sphere.ByCenterPointRadius(flatPts, 0.15); }

# group: for test Learning Model
watch_sphere_for_test_model = Watch(code_block_4.sph)

# group: Model Learning with tensorflow
python_script_main_learning = Python(IN[0]=watch_points, IN[1]=watch_is_inside_circle_bool, IN[2]=watch_sphere_for_test_model)  # CPython3
# ---------- python_script_main_learning.python (98 lines) ----------
import sys
import clr
import System

clr.AddReference('ProtoGeometry')
from Autodesk.DesignScript.Geometry import *
clr.AddReference('GeometryColor')
from Modifiers import GeometryColor
clr.AddReference('DSCoreNodes')
from DSCore import Color

clr.AddReference('System.Windows.Forms')
import System.Windows.Forms
from System.Windows.Forms import MessageBox, MessageBoxButtons

dirAppLoc = System.Environment.GetFolderPath(System.Environment.SpecialFolder.LocalApplicationData) 
sys.path.append(dirAppLoc + r'\python-3.8.3-embed-amd64\Lib\site-packages')
datacsv = dirAppLoc + "\\dataTensorFlow.csv"

# force to reload module
if "tensorflow" in sys.modules:
    del sys.modules["tensorflow"]

import numpy as np
import tensorflow as tf
from tensorflow import keras
from tensorflow.keras import layers
from tensorflow.python.client import device_lib

from io import StringIO    

sys.stdout = StringIO()
print("Num GPUs Available: ", len(tf.config.list_physical_devices('GPU')))
print(device_lib.list_local_devices())

LEARNING_RATE = 0.01 
EPOCH_COUNT = 2000 
max_accuracy = 80
# get X and Y from randoms points
x = np.array([[pt.X, pt.Y] for pt in IN[0]], dtype=np.float32) 
# convert bool to integer
y = np.array([int(x) for x in IN[1]], dtype=np.float32) 
# get X and Y from Test points for prediction
lstSpheres = IN[2]
testPoints = np.array([[sphere.CenterPoint.X, sphere.CenterPoint.Y] for sphere in lstSpheres], dtype=np.float32)
outGeometry = []

### Different activation ###
# softmax , tanh , relu , sigmoid
#
### Different loss ###
# binary_crossentropy , mean_squared_error , squared_hinge , categorical_crossentropy , sparse_categorical_crossentropy
#
model = keras.Sequential()
model.add(keras.layers.Dense(units=5,  input_shape=x.shape, activation='relu'))
model.add(keras.layers.Dense(units=5, activation='relu'))
model.add(keras.layers.Dense(units=2, activation='sigmoid')) 

#optimizer = tf.keras.optimizers.SGD(learning_rate = LEARNING_RATE)
optimizer = tf.keras.optimizers.Adam(learning_rate = LEARNING_RATE)

model.compile(optimizer=optimizer,
              loss='sparse_categorical_crossentropy',
              metrics=['accuracy'])
 
# train the model  
i = 0
final_accuracy = 0
while i < 3 and final_accuracy <= max_accuracy * 0.01:

    model.fit(x, y, epochs=EPOCH_COUNT)
    # get the final accuracy
    final_accuracy = round(model.history.history['accuracy'][-1], 2)
    i += 1

model.summary()
print(f"final_accuracy : {final_accuracy}")
# test Prediction
if final_accuracy > max_accuracy * 0.01:
    result1 = model.predict(testPoints)
    # color the result
    for idx, (sph, (out1, out2)) in enumerate(zip(lstSpheres, result1)):
        factor = 1 if out2 > 0.001 else 0
        print("probability shpere at index {} is inside circle : {}%".format(idx, round((1 - out1) * factor,  2) * 100))
        if out1  < 0.1 and out2 > 0.001:
            geocolor = GeometryColor.ByGeometryColor(sph, Color.ByARGB(255,0,255,0))
            outGeometry.append(geocolor)
        else:
            geocolor = GeometryColor.ByGeometryColor(sph, Color.ByARGB(255,255,0,0))
            outGeometry.append(geocolor)    
else:
    MessageBox.Show(f'precsion du modele insuffisante {final_accuracy * 100}% (< {max_accuracy}%)\n relancer le script', 'Error', MessageBoxButtons.OK)
    outGeometry = lstSpheres
    result1 = []

sys.stdout.seek(0)
readerstdout =  sys.stdout.read()
OUT = readerstdout, result1, outGeometry
# ----------------------------------------
code_block_5 = CodeBlock(x=python_script_main_learning) { x[0]; }
# note: Package Springs
ꟿ_watchdialog = Custom[ꟿ WatchDialog](input=code_block_5)  # package spring nodes; This node that serializes the input information and presents it in a resizable text window.
