# Dynamo graph Working with Python Modules (CPython3).dyn (Dynamo 2.13.0.3485)

# group: Test1
python_script_foo = Python()  # CPython3; unwired: IN[0]
# ---------- python_script_foo.python (70 lines) ----------
# https://stackoverflow.com/questions/65009309/dynamically-import-module-from-memory-in-python-3-using-hooks
import sys
import clr
import importlib
from importlib.abc import Loader, MetaPathFinder
import types
clr.AddReference('ProtoGeometry')
from Autodesk.DesignScript.Geometry import *

class StringLoader(Loader):

    def __init__(self, modules):
        self._modules = modules

    def has_module(self, fullname):
        return (fullname in self._modules)

    def create_module(self, spec):
        if self.has_module(spec.name):
            module = types.ModuleType(spec.name)
            return self._modules[spec.name]()

    def exec_module(self, module):
        pass


class StringFinder(MetaPathFinder):

    def __init__(self, loader):
        self._loader = loader

    def find_spec(self, fullname, path, target=None):
        if self._loader.has_module(fullname):
            return importlib.machinery.ModuleSpec(fullname, self._loader)

class Foo():
    guid = "a8c3aa76-f731-4086-ae08-8cb41464e425"
    def __init__(self):
        self.args = [chr(i) for i in range(97, 103)]
        
    def __name__(self):
        return "Foo"
        
    def bar(self):
        return ', '.join(self.args)
        
    def Test(self):
        return Point.ByCoordinates(1,2,-3)

moduleName = Foo.__name__
# MAKE A DICT OF MODULES
modules = {moduleName: Foo}
# PURGE PREVIOUS MODULES
for i in range(10):
    for idx, m in enumerate(sys.meta_path):
        if hasattr(m, "_loader") and hasattr(m._loader, "_modules") and moduleName in m._loader._modules:
            sys.meta_path.pop(idx)
            break
# DEL PREVIOUS MODULE IN sys.modules
if moduleName in sys.modules:
    del sys.modules[moduleName]
# IMPORT MODULE IN sys.meta_path
finder = StringFinder(StringLoader(modules))
sys.meta_path.append(finder)
import Foo
####################################################################################
##### NOW MODULE Foo IS ACCESSIBLE IN ALL OTHER PYTHON NODES JUST NEED IMPORT ######
####################################################################################

OUT = 0
# ----------------------------------------
python_script_foo2 = Python()  # CPython3; unwired: IN[0]
# ---------- python_script_foo2.python (73 lines) ----------
# https://stackoverflow.com/questions/65009309/dynamically-import-module-from-memory-in-python-3-using-hooks
import sys
import clr
import importlib
from importlib.abc import Loader, MetaPathFinder
import types
clr.AddReference('ProtoGeometry')
from Autodesk.DesignScript.Geometry import *

class StringLoader(Loader):

    def __init__(self, modules):
        self._modules = modules

    def has_module(self, fullname):
        return (fullname in self._modules)

    def create_module(self, spec):
        if self.has_module(spec.name):
            module = types.ModuleType(spec.name)
            return self._modules[spec.name]()

    def exec_module(self, module):
        pass


class StringFinder(MetaPathFinder):

    def __init__(self, loader):
        self._loader = loader

    def find_spec(self, fullname, path, target=None):
        if self._loader.has_module(fullname):
            #self.moduleName = fullname
            return importlib.machinery.ModuleSpec(fullname, self._loader)

class Foo2():
    """
    This a test
    """
    guid = "a8c3aa76-f731-4086-ae08-8cb41464e425"
    def __init__(self):
        self.args = [chr(i) for i in range(105, 115)]
        
    def __name__(self):
        return "Foo2"
        
    def bar(self):
        """
        bar doc
        """
        return ', '.join(self.args)
    def Test(self):
        """
        Test doc
        """
        return Point.ByCoordinates(12,12,12)

moduleName = Foo2.__name__
modules = {moduleName: Foo2}
for i in range(10):
    for idx, m in enumerate(sys.meta_path):
        if hasattr(m, "_loader") and hasattr(m._loader, "_modules") and moduleName in m._loader._modules:
            sys.meta_path.pop(idx)
            break
finder = StringFinder(StringLoader(modules))
sys.meta_path.append(finder)
if moduleName in sys.modules:
    del sys.modules[moduleName]
import Foo2


OUT = 0
# ----------------------------------------
python_script_main = Python(IN[0]=python_script_foo, IN[1]=python_script_foo2)  # CPython3
# ---------- python_script_main.python (11 lines) ----------
# Charger les bibliothèques DesignScript et Standard Python
import sys
import clr
clr.AddReference('ProtoGeometry')
from Autodesk.DesignScript.Geometry import *

import Foo
import Foo2
pta = Foo.Test()
ptb = Foo2.Test()
OUT = Line.ByStartPointEndPoint(pta, ptb), Foo.bar()
# ----------------------------------------
