# Dynamo graph Working with Python Modules (IronPython2).dyn "Working with Python Modules" (Dynamo 2.3.0.5885)

python_script_module = Python()  # "Python Script | Module CheckerWorkset"
# ---------- python_script_module.python (39 lines) ----------
import clr

clr.AddReference("RevitServices")
import RevitServices
from RevitServices.Persistence import DocumentManager
doc = DocumentManager.Instance.CurrentDBDocument

clr.AddReference("RevitAPI")
from Autodesk.Revit.DB import *


class CheckerWorkset():
	guid = "a8c3aa76-f731-4086-ae08-8cb41464e425"
	def __init__(self):
		self._fecElems = FilteredElementCollector(doc).OfClass(FamilyInstance).WhereElementIsNotElementType().ToElements()
		fecWkset = FilteredWorksetCollector(doc).OfKind(WorksetKind.UserWorkset)
		self._dictWkset = {x.Id : x.Name for x in fecWkset}
		
	def __name__(self):
		return "CheckerWorkset"
		
	def checkElemUsers(self):
		outCheck = []	
		outCheck.append(["Id", "Name", "Creator", "LastChangedBy"])
		for x in self._fecElems:	
			tooltip = WorksharingUtils.GetWorksharingTooltipInfo(doc, x.Id)
			outCheck.append([x.Id, x.Name, tooltip.Creator, tooltip.LastChangedBy])
		return outCheck
		
	def checkElemWorkset(self):
		outCheck = []	
		outCheck.append(["Id", "Name", "WorksetName"])
		for x in self._fecElems:	
			wksetName = self._dictWkset.get(x.WorksetId)
			outCheck.append([x.Id, x.Name, wksetName])
		return outCheck	
	
	
OUT = CheckerWorkset
# ----------------------------------------
python_script_module_userui = Python()
# ---------- python_script_module_userui.python (76 lines) ----------
import clr
clr.AddReference('ProtoGeometry')
from Autodesk.DesignScript.Geometry import *

clr.AddReference('System.Drawing')
clr.AddReference('System.Windows.Forms')
import System.Drawing
import System.Windows.Forms

from System.Drawing import *
from System.Windows.Forms import *


class UserUI():
	guid = "a8c3aa76-f731-4086-ae08-8cb41464e425"
	def __init__(self):
		pass
		
	def __name__(self):
		return "UserUI"
		
	def selectFolder(self):
		folderBrowserDialog1 = System.Windows.Forms.FolderBrowserDialog()
		result = folderBrowserDialog1.ShowDialog()
		folderName = folderBrowserDialog1.SelectedPath
		return folderName
	
	class UserForm(Form):
		def __init__(self, title, text1, text2):
			self._title = title
			self._text1 = text1
			self._text2 = text2
			self.choice = None
			self.InitializeComponent()
		
		def InitializeComponent(self):
			self._Process1 = System.Windows.Forms.Button()
			self._Process2 = System.Windows.Forms.Button()
			self.SuspendLayout()
			# 
			# Process1
			# 
			self._Process1.Location = System.Drawing.Point(33, 62)
			self._Process1.Name = "input1" 
			self._Process1.Size = System.Drawing.Size(177, 47)
			self._Process1.TabIndex = 0
			self._Process1.Text = self._text1 
			self._Process1.UseVisualStyleBackColor = True
			self._Process1.Click += self.ProcessClick
			# 
			# Process2
			# 
			self._Process2.Location = System.Drawing.Point(250, 62)
			self._Process2.Name = "input2" 
			self._Process2.Size = System.Drawing.Size(177, 47)
			self._Process2.TabIndex = 0
			self._Process2.Text = self._text2
			self._Process2.UseVisualStyleBackColor = True
			self._Process2.Click += self.ProcessClick
			# 
			# Form6
			# 
			self.ClientSize = System.Drawing.Size(476, 165)
			self.Controls.Add(self._Process2)
			self.Controls.Add(self._Process1)
			self.Name = "Form6"
			self.Text = self._title 
			self.ResumeLayout(False)
	
	
		def ProcessClick(self, sender, e):
			self.choice = sender.Text
			self.Close()


OUT = UserUI
# ----------------------------------------
python_script_module_exportutils = Python()
# ---------- python_script_module_exportutils.python (65 lines) ----------
import clr
import sys
clr.AddReference('ProtoGeometry')
from Autodesk.DesignScript.Geometry import *

import System
from System import Array
from System.Collections.Generic import *

clr.AddReference('System.Drawing')
import System.Drawing
from System.Drawing import *


clr.AddReferenceByName('Microsoft.Office.Interop.Excel, Version=11.0.0.0, Culture=neutral, PublicKeyToken=71e9bce111e9429c' )
from Microsoft.Office.Interop import Excel
from System.Runtime.InteropServices import Marshal

pf_path = System.Environment.GetFolderPath(System.Environment.SpecialFolder.ProgramFilesX86)
sys.path.append('%s\IronPython 2.7\Lib' % pf_path)
import csv



class ExportUtils():
	guid = "a8c3aa76-f731-4086-ae08-8cb41464e425"
	
	def __init__(self):
		pass
		
	def __name__(self):
		return "ExportUtils"	

		
	def exportXls(self, datas, folderpath):
		filePath = folderpath + '\\recap.xlsx'
		ex = Excel.ApplicationClass()
		ex.Visible = True
		ex.DisplayAlerts = False
		workbook = ex.Workbooks.Add()
		workbook.SaveAs(filePath)
		ws = workbook.Worksheets[1]	
		nbr_row = len(datas)
		nbr_colum = len(datas[0])
		xlrange  = ws.Range[ws.Cells(1, 1), ws.Cells(nbr_row, nbr_colum)]
		a = Array.CreateInstance(object, nbr_row, nbr_colum)
		for indexR, row in enumerate(datas):
			for indexC , value in  enumerate(row):
				a[indexR,indexC] = value
				
		#copy Array in range			
		xlrange.Value2 = a		
		used_range = ws.UsedRange	
		for column in used_range.Columns:
			column.AutoFit()
			
			
	def exportCsv(self, datas, folderpath):
		filePath = folderpath + '\\recap.csv'
		with open(filePath, 'w') as f:
			writer = csv.writer(f, lineterminator='\n')
			writer.writerows(datas)		
			
			
OUT  = 	ExportUtils		
# ----------------------------------------
python_script_main = Python(IN[0]=python_script_module, IN[1]=python_script_module_userui, IN[2]=python_script_module_exportutils)
# ---------- python_script_main.python (53 lines) ----------
import clr
import sys

class FinderImporter(object):
	def __init__(self, module):
		self._module = module
		self._guid = "a8c3aa76-f731-4086-ae08-8cb41464e425"

	def find_module(self, fullname, path=None):
		if fullname in self._module.__name__:
			if self._guid == self._module.guid :
				return self
			else:   
				return None	
		else: 	
			return None
	def load_module(self, fullname):
		if  fullname not in self._module.__name__:
			if self._guid != self._module.guid :
				raise ImportError(fullname)
		return self._module()
		
modulesEntry = IN
##Method to Load internal Module##
for mod in modulesEntry:
	sys.meta_path.append(FinderImporter(mod))

import UserUI
from UserUI import *
import ExportUtils
import CheckerWorkset


varinput1 = "Checker les sous projects"
varinput2 = "Checker les Utilisateur"
objForm1 = UserForm("Check Elements", varinput1, varinput2)
objForm1.ShowDialog()
if objForm1.choice == varinput1:
	lstCheck = CheckerWorkset.checkElemWorkset()
else:
	lstCheck = CheckerWorkset.checkElemUsers()

if 'lstCheck' in locals():
    varinput1 = "Export Excel"
    varinput2 = "Export csv"
    objForm1 = UserForm("Check Elements", varinput1, varinput2)
    objForm1.ShowDialog()
    folderpath = selectFolder()
    if objForm1.choice == varinput1:
        ExportUtils.exportXls(lstCheck, folderpath)
    else:   
        ExportUtils.exportCsv(lstCheck, folderpath)
OUT = dir(UserUI), objForm1.choice, lstCheck
# ----------------------------------------
